# Grasshopper definition RC_floor_options.gh (Grasshopper 1.0.8)
# plug-ins: MeshEdit Components

enable_canvas_portal = BooleanToggle(False)
portal = Portal(A=enable_canvas_portal, W=Slider(0.4, range=0..1))
# ---------- portal: VB usings ----------
Imports System.IO
Imports System.Linq
Imports System.Data
Imports System.Drawing
Imports System.Reflection
Imports System.Windows.Forms
Imports System.Xml
Imports System.Xml.Linq
Imports Microsoft.VisualBasic
Imports System.Runtime.InteropServices

Imports Rhino.DocObjects
Imports Rhino.Collections
Imports GH_IO
Imports GH_IO.Serialization
# ---------- portal: VB ----------
    component.Params.Input(0).Name = "Activate"
    component.Params.input(0).Description = "Active the Portal"
    component.Params.Input(1).Name = "Width"
    component.Params.Input(1).Description = "Width of Portal"

    If (A = m_A) Then Return
    m_A = A
    m_W = W
    If (A) Then
      AddHandler Instances.ActiveCanvas.CanvasPaintBackground, AddressOf PaintHandler
    Else
      RemoveHandler Instances.ActiveCanvas.CanvasPaintBackground, AddressOf PaintHandler
    End If
# ---------- portal: VB additional code ----------
  Private m_A As Boolean = False
  Public m_W As Double '<---------------- This param.
  Private Sub PaintHandler(ByVal sender As Grasshopper.GUI.Canvas.GH_Canvas)

    sender.Graphics.ResetTransform()

    Dim ancho As Double = sender.Width * m_W

    Dim pen As New pen (color.FromArgb(255, 65, 65, 65), 10)

    Dim rect As rectangle = GH_convert.ToRectangle(New Rectangle(5, 5, ancho, sender.Height - 10))
    sender.Graphics.DrawRectangle(pen, rect)

    Dim brush As New Solidbrush (color.Snow)
    sender.Graphics.FillRectangle(brush, rect)

    brush.Dispose()

    pen.Dispose()

    sender.Viewport.ApplyProjection(sender.Graphics)


    Dim form As system.Windows.Forms.Form = Grasshopper.Instances.DocumentEditor

    form.TransparencyKey = color.Snow
    form.show()
  End Sub
# ---------- end portal ----------
# XXX Floor options Rhino.Compute_v1
# Date XX/XX/25
# Rhino units - mm / m / any
# Description: Brief over-arching description to describe logic, what inputs, what outputs or what achieved
author_s = Panel("""X
Y
Z""")
xgrid = GetNumber(
    Slider(5, range=4..12),
    AtLeast=4,
    AtMost=12,
    Maximum=1.797693135e+308,
    Minimum=-1.797693135e+308,
    Prompt="5",
    TreeAccess=False)
ygrid = GetNumber(Slider(6, range=4..12), AtLeast=4, AtMost=12, Maximum=1.797693135e+308, Minimum=-1.797693135e+308, TreeAccess=False)

# ---- group: User Input
panel = Panel("X Grid spacing")
panel_2 = Panel("Y Grid spacing")

# ----
squarebay = GetBoolean(Toggle(True), AtLeast=1, AtMost=1, FalseValue="False", Prompt="False", TreeAccess=False, TrueValue="True")
number_slider = Slider(2, range=2..9)
filter = StreamFilter(Gate=squarebay, Stream0=ygrid, Stream1=xgrid)
multiplication = Multiplication(A=xgrid, B=1000)
x_bay_m = Number(xgrid)
multiplication_2 = Multiplication(A=filter, B=1000)
x_bay = Number(x_bay_m)
y_bay_m = Number(filter)
y_bay = Number(y_bay_m)
pt = ConstructPoint(XCoordinate=x_bay_m, YCoordinate=y_bay_m, ZCoordinate=0)
rec_2pt = Rectangle2Pt(Plane=PlaneXY(0, 0, 0), PointA=Point(0, 0, 0), PointB=pt, Radius=0)  # -> Rectangle, Length

# ----
# Slabs
# Columns
panel_3 = Panel("3")
series = Series(Start=0, Step=x_bay_m, Count="5")
series_2 = Series(Start=0, Step=y_bay_m, Count="5")
column_height = Number(panel_3)
X = UnitX(Factor=series)
Y = UnitY(Factor=series_2)
# Translations
move = Move(Motion=X)  # -> Geometry, Transform
move_2 = Move(Motion=Y)  # -> Geometry, Transform
Z = UnitZ(Factor=column_height)
move_3 = Move(Motion=Z)  # -> Geometry, Transform
cull_i = CullIndex(List=move_2.Transform, Indices=-1, Wrap=True)
cull_i_2 = CullIndex(List=move.Transform, Indices=-1, Wrap=True)
z_move = Transform(move_3.Transform)
x_array = Transform(graft(move.Transform))
x_array_2 = Transform(graft(cull_i_2))
y_array = Transform(move_2.Transform)
y_array_2 = Transform(cull_i)
long = LongestList(ListA=x_array, ListB=y_array, PaddingMode=2)  # -> ListA, ListB
long_2 = LongestList(ListA=x_array_2, ListB=y_array_2, ListC=z_move, PaddingMode=2)  # -> ListA, ListB, ListC
merge = Merge(Data1=graft(long.ListA), Data2=graft(long.ListB))
merge_2 = Merge(Data1=graft(long_2.ListA), Data2=graft(long_2.ListB), Data3=graft(long_2.ListC))
comp = Compound(Transforms=merge)
comp_2 = Compound(Transforms=merge_2)

max = Maximum(A=x_bay_m, B=y_bay_m)
division = Division(A=max, B=1000)
# Concrete Flat slab- ECFE tables
span = Panel("""4
5
6
7
8
9
10
11
12""")
consec = ConsecutiveDomains(Numbers=span, Additive=False)
flat_slab_thickness = Panel("""200
200
215
246
284
347
427
479
565""")
column = Panel("""200
200
215
246
284
347
427
479
565""")
fdom = FindDomain(Domains=consec, Number=max, Strict=False)  # -> Index, Neighbour
consec_2 = ConsecutiveDomains(Numbers=column, Additive=False)
consec_3 = ConsecutiveDomains(Numbers=flat_slab_thickness, Additive=False)
item = ListItem(List=consec, Index=fdom.Index, Wrap=False)
box = Box2Pt(PointA="0,0,0", PointB="1,1,1", Plane=PlaneXY(0, 0, 0))
box_2 = Box2Pt(PointA="-0.5,-0.5,0", PointB="0.5,0.5,1", Plane=PlaneXY(0, 0, 0))
item_2 = ListItem(List=consec_3, Index=fdom.Index, Wrap=True)
item_3 = ListItem(List=consec_2, Index=fdom.Index, Wrap=True)
mbox = MeshBox(Base=box, XCount=1, YCount=1, ZCount=1)
mbox_2 = MeshBox(Base=box_2, XCount=1, YCount=1, ZCount=1)
remap = RemapNumbers(Value=max, Source=item, Target=item_2)  # -> Mapped, Clipped
remap_2 = RemapNumbers(Value=max, Source=item, Target=item_3)  # -> Mapped, Clipped
unit_mesh = Mesh(mbox)
unit_mesh_centreline = Mesh(mbox_2)
division_2 = Division(A=remap.Mapped, B=1000)
column_sq = Number(remap_2.Mapped)
z_height = Number(division_2)
transform = Transform(Geometry=rec_2pt.Rectangle, Transform=comp_2)

# ---- group: Scale Slab
z_thickness = Number(z_height)
y_bay_2 = Number(y_bay)
x_bay_2 = Number(x_bay)
neg = Negative(Value=z_thickness)
# Conc Slab
scale_nu = ScaleNU(Plane=PlaneXY(0, 0, 0), ScaleX=x_bay_2, ScaleY=y_bay_2, ScaleZ=neg)  # -> Geometry, Transform

# ----
crv = Curve(transform)  # disabled
num = Number(z_height)  # disabled
# Construct mesh
graft = GraftTree(Tree=crv, IncludeEmptyLists=True, IncludeNullItems=True)  # disabled
Z_2 = UnitZ(Factor=expr("-x", num))  # disabled
move_4 = Move(Geometry=graft, Motion=Z_2)  # -> Geometry, Transform; disabled
mesh = Mesh(graft)  # disabled
move_5 = Move(Geometry=mesh, Motion=Z_2)  # -> Geometry, Transform; disabled
merge_3 = Merge(Data1=graft, Data2=move_4.Geometry)  # disabled
loftmesh = CSharpScript(Polylines=merge_3, Weld=0.9)  # -> out, Mesh; inputs Polylines: list of Polyline, UTextureSize: Double, VTextureSize: Double, Weld: Double; disabled
# ---------- loftmesh: C# usings ----------
using System.Linq;
using Rhino.Render;
# ---------- loftmesh: C# ----------
    if (Polylines.Count == 0)
      return;

    // number of polyline vertices
    int numPolylineVertices = Polylines[0].Count;

    //Get crossed lengths (for texture coordinate computation)
    List<double> XLengths = new List<double>();
    double totalXLengths = 0;
    for (int i = 0; i < numPolylineVertices; i++)
    {
      double totalLength = 0;
      for (int j = 1; j < Polylines.Count; j++)
        totalLength += (Polylines[j][i] - Polylines[j - 1][i]).Length;
      totalXLengths += totalLength;
      XLengths.Add(totalLength);
    }

    //compute UV scale
    double VSize = (VTextureSize == 0) ? 1 : VTextureSize / (totalXLengths / XLengths.Count);

    double totalYLengths = 0;
    for (int i = 0; i < Polylines.Count; i++)
      totalYLengths += Polylines[i].Length;

    double USize = (UTextureSize == 0) ? 1 : UTextureSize / (totalYLengths / Polylines.Count);

    // construct mesh
    Mesh m = new Mesh();

    // loop over polylines
    for (int i = 0; i < Polylines.Count; i++)
    {
      // compute polyline segment lengths (for texture coordinate computation)
      List<double> arrTexCoordY = new List<double>();
      double curLengthY = 0;
      arrTexCoordY.Add(curLengthY);
      for (int j = 1; j < numPolylineVertices; j++) {
        curLengthY += (Polylines[i][j] - Polylines[i][j - 1]).Length;
        arrTexCoordY.Add(curLengthY / (Polylines[i].Length * USize));
      }

      int prevBase = i * numPolylineVertices;
      int curBase = (i + 1) * numPolylineVertices;
      for (int j = 0; j < numPolylineVertices; j++) {

        double curLengthX = 0;
        for (int k = 1; k <= i; k++)
          curLengthX += (Polylines[k][j] - Polylines[k - 1][j]).Length;

        m.Vertices.Add(Polylines[i][j]);
        m.TextureCoordinates.Add(arrTexCoordY[j], curLengthX / (XLengths[j] * VSize));
        m.Faces.AddFace(curBase + j - 1, curBase + j, prevBase + j, prevBase + j - 1);
      }
    }

    m.Vertices.CullUnused();
    m.Faces.CullDegenerateFaces();
    m.RebuildNormals();

    // fix normals along the seam
    int lastBase = (Polylines.Count - 1) * numPolylineVertices;
    for (int i = 0; i < numPolylineVertices; i++) {
      Vector3f n1 = m.Normals[i];
      Vector3f n2 = m.Normals[i + lastBase];
      Vector3f n = n1 + n2;
      n.Unitize();
      m.Normals.SetNormal(i, n);
      m.Normals.SetNormal(i + lastBase, n);
    }

    m.Unweld(Weld, true);

    Mesh = m;
# ---------- end loftmesh ----------
mjoin = MeshJoin(Meshes=[move_5.Geometry, loftmesh.Mesh, mesh])  # disabled
swatch = ColourSwatch(SwatchColor=RGB(143, 143, 143))  # disabled
preview = CustomPreview(Geometry=mjoin, Material=swatch)  # disabled

long_3 = LongestList(ListA=scale_nu.Transform, ListB=comp_2, PaddingMode=2)  # -> ListA, ListB
merge_4 = Merge(Data1=long_3.ListA, Data2=long_3.ListB)
comp_3 = Compound(Transforms=merge_4)
unit_mesh_centreline_2 = Mesh(unit_mesh_centreline)
transform_2 = Transform(Geometry=unit_mesh, Transform=comp_3)
volume = Volume(Geometry=transform_2)  # -> Volume, Centroid
abs = Absolute(Value=volume.Volume)
ma = MassAddition(Input=flatten(abs))  # -> Result, PartialResults
y_count = Number(expr("x-1", "5"))
x_count = Number(expr("x-1", "5"))
y_bay_m_2 = Number(y_bay_m)
x_bay_m_2 = Number(x_bay_m)
kg_per_m3 = Panel("2400")
a1_to_a5_eci = Panel("0.133")
multiplication_3 = Multiplication(A=x_bay_m_2, B=y_bay_m_2, C=x_count, D=y_count)
multiplication_4 = Multiplication(A=ma.Result, B=kg_per_m3)
multiplication_5 = Multiplication(A=multiplication_4, B=a1_to_a5_eci)
division_3 = Division(A=multiplication_5, B=multiplication_3)
expression = Expression(x=division_3, Expression="round((x*10),0)/10")
concat = Concatenate(FragmentA=expression, FragmentB="kg/m2")
embodied_carbon = ContextPrint(Text=concat)

# ---- group: Scale Column
column_height_2 = Number(column_height)
column_sq_2 = Number(column_sq)

# ----
division_4 = Division(A=column_sq_2, B=1000)

# ---- group: Scale Column (continued)
# Conc Column
scale_nu_2 = ScaleNU(Plane=PlaneXY(0, 0, 0), ScaleX=division_4, ScaleY=division_4, ScaleZ=column_height_2)  # -> Geometry, Transform

# ----
long_4 = LongestList(ListA=scale_nu_2.Transform, ListB=comp, PaddingMode=2)  # -> ListA, ListB
merge_5 = Merge(Data1=long_4.ListA, Data2=long_4.ListB)
comp_4 = Compound(Transforms=merge_5)
transform_3 = Transform(Geometry=unit_mesh_centreline_2, Transform=comp_4)
volume_2 = MeshVolume(Mesh=transform_3)  # -> Volume, Centroid
merge_6 = Merge(Data1=transform_2, Data2=transform_3)  # -> flatten(Result)
geometry = Geometry(merge_6)
context_bake = ContextBake(Geometry=flatten(merge_6))
