# Grasshopper definition Transfer_model.gh (Grasshopper 1.0.8)

# Span
transfer_location = GetNumber(AtLeast=1, AtMost=1, Maximum=1.797693135e+308, Minimum=-1.797693135e+308, TreeAccess=False)
# Location of transfer
span = GetNumber(AtLeast=1, AtMost=1, Maximum=1.797693135e+308, Minimum=-1.797693135e+308, TreeAccess=False)
# Load
load = GetNumber(AtLeast=1, AtMost=1, Maximum=1.797693135e+308, Minimum=-1.797693135e+308, TreeAccess=False)
multiplication = Multiplication(A=span, B=1000)
# a
multiplication_2 = Multiplication(A=transfer_location, B=multiplication)
# b
subtraction = Subtraction(A=multiplication, B=multiplication_2)
pt = ConstructPoint(XCoordinate=multiplication_2, YCoordinate=0, ZCoordinate=0)

# ----
# Rb
expression = Expression(P=load, a=multiplication_2, L=multiplication, Expression="P*a / L")

# ----
# Ra
expression_2 = Expression(P=load, b=subtraction, L=multiplication, Expression="P*b / L")  # -> graft(R)

ra = Expression(a=multiplication_2, R_a=expression_2, x=multiplication_2, P=load, Expression="(-R_a*x + P*(x-a))/100")
list = ValueList({"S275": 275, "S355": 355, "S460": 460}, selected="S355")
max = Maximum(A=expression, B=expression_2)
pt_2 = ConstructPoint(XCoordinate=multiplication_2, YCoordinate=ra, ZCoordinate=0)
expression_3 = Expression(M_Ed=max, f_yd=list, Expression="M_Ed*10^6 / f_yd")
division = Division(A=expression_3, B=1000)
vec2pt = Vector2Pt(PointA=pt, PointB=pt_2, Unitize=False)  # -> Vector, Length

pt_3 = ConstructPoint(XCoordinate=multiplication, YCoordinate=0, ZCoordinate=0)
pt_4 = ConstructPoint(XCoordinate=0, YCoordinate=0, ZCoordinate=0)
ln = Line(StartPoint=pt_4, EndPoint=pt_3)
divdist = DivideDistance(Curve=ln, Distance=Slider(100, range=0..100))  # -> Points, Tangents, Parameters
pdecon = Deconstruct(Point=divdist.Points)  # -> XComponent, YComponent, ZComponent
larger = LargerThan(FirstNumber=pdecon.XComponent, SecondNumber=multiplication_2)  # -> LargerThan, OrEqualTo
multiplication_3 = Multiplication(A=larger.LargerThan, B=load)

# ----
# Compute BMD at point x
ra_2 = Expression(a=multiplication_2, R_a=expression_2, x=pdecon.XComponent, P=multiplication_3, Expression="(-R_a*x + P*(x-a))/100")

pt_5 = ConstructPoint(XCoordinate=pdecon.XComponent, YCoordinate=ra_2, ZCoordinate=0)
pline = PolyLine(Vertices=pt_5, Closed=True)

mesh = Mesh(pline)
pt_6 = Point(pt_4)
pt_7 = Point(pt_3)
merge = Merge(Data1=mesh, Data2=pt_6, Data3=pt_7)
c_bake = ContextBake(Content=merge)
